# Grasshopper definition BranchNodeRnd.gh (Grasshopper 1.0.7)
# plug-ins: Pufferfish
# Sample shows how to use contextual inputs in a GH document that gets solved by RhinoCompute. Returns a draco compressed mesh as a string.

cell_radius = Slider(100, range=0..500)
cell_radius_2 = Slider(80.96, range=0..500)
radius = GetNumber(cell_radius_2, AtLeast=1, AtMost=2147483647, Maximum=1.797693135e+308, Minimum=-1.797693135e+308, TreeAccess=False)
offset = GetInteger(Slider(6, range=1..100), AtLeast=1, AtMost=2147483647, Maximum=2147483647, Minimum=-2147483648, TreeAccess=False)
height = GetNumber(cell_radius, AtLeast=1, AtMost=2147483647, Maximum=1.797693135e+308, Minimum=-1.797693135e+308, TreeAccess=False)

pt = ConstructPoint(XCoordinate=0, YCoordinate=0, ZCoordinate=0)  # disabled
msphere = MeshSphere(Base=pt, Radius=radius, UCount=10, VCount=20)  # disabled
popgeo = PopulateGeometry(Geometry=msphere, Count=offset, Seed=1)  # disabled
facet = FacetDome(Points=popgeo, Radius=radius)  # -> Pattern, Dome; disabled
explode = Explode(Curve=facet.Pattern, Recursive=True)  # -> Segments, Vertices; disabled
curvepoint = PointOnCurve(explode.Segments, parameter=0.5)  # disabled
lng = ListLength(List=explode.Segments)  # disabled
avr = Average(Input=curvepoint)  # disabled
vec2pt = Vector2Pt(PointA=pt, PointB=avr, Unitize=invert(False))  # -> Vector, Length; disabled
amp = Amplitude(Vector=vec2pt.Vector, Amplitude=height)  # disabled
addition = Addition(A=avr, B=amp)  # disabled
end = EndPoints(Curve=graft(explode.Segments))  # -> Start, End; disabled
dup = DuplicateData(Data=addition, Number=lng, Order=True)  # disabled
pshift = ShiftPaths(Data=dup, Offset=-1)  # -> graft(Data); disabled
merge = Merge(Data1=end.Start, Data2=end.End, Data3=pshift)  # disabled
triangle = MeshTriangle(CornerA=0, CornerB=1, CornerC=2)  # disabled
conmesh = ConstructMesh(Vertices=merge, Faces=triangle)  # disabled

neg = Negative(Value=offset)
Z = UnitZ(Factor=1)
amp_2 = Amplitude(Vector=Z, Amplitude=offset)
circle = CircleCNR(Center="0,0", Normal=Vector(0, 0, 1), Radius=radius)
offcrv = OffsetCurve(Curve=circle, Plane=PlaneXY(0, 0, 0), Distance=offset, BothSides=neg, Kinks=0, CapType=1)
sort = SortList(Keys=offcrv, ValuesA=offcrv)  # -> Keys, ValuesA
item = ListItem(List=sort.ValuesA, Index=0, Wrap=True)  # -> flatten(Item)
boundary = BoundarySurfaces(Edges=circle)
boundary_2 = BoundarySurfaces(Edges=[circle, item])
move = Move(Geometry=boundary_2, Motion=amp_2)  # -> Geometry, Transform
Z_2 = UnitZ(Factor=1)
Z_3 = UnitZ(Factor=1)
amp_3 = Amplitude(Vector=Z_2, Amplitude=offset)
amp_4 = Amplitude(Vector=Z_3, Amplitude=height)
extr = Extrude(Base=move.Geometry, Direction=amp_4)
extr_2 = Extrude(Base=boundary, Direction=amp_3)
mjoin = MeshJoin(Meshes=flatten([extr_2, extr]))
alignvert = AlignVertices(Tolerance=0.1)  # -> Result, Count; disabled
weld = WeldMesh(Mesh=alignvert.Result, Angle=3.141592654)  # disabled
subdmesh = SubDFromMesh(Mesh=weld, Creases=1, Corners=1, Interpolate=False)  # disabled
meshsubd = MeshFromSubD(SubD=subdmesh, Density=2)  # disabled
context_bake = ContextBake(MeshGeometry=meshsubd)  # disabled
c_script = CSharpScript(mesh=mjoin)  # -> base64Draco; inputs mesh: Mesh
# ---------- c_script: C# ----------
    var options = new Rhino.FileIO.DracoCompressionOptions();
    options.CompressionLevel = 5;
    options.IncludeTextureCoordinates = false;
    options.IncludeVertexColors = false;

    var compressed = Rhino.FileIO.DracoCompression.Compress(mesh, options);
    base64Draco = compressed.ToBase64String();
# ---------- end c_script ----------
preview = CustomPreview(Geometry=mjoin, Material=ColourSwatch(SwatchColor=RGBA(255, 255, 255, 56)))
context_print = ContextPrint(B64Mesh=c_script)
